vi "CLT.gvi"   [LabVIEW Communications System Design Suite 2.0.1]
panel controls:
  "milliseconds to wait": u32
  "number of bins": i32 = 10
  "number of bins_2": i32 = 10
panel indicators:
  "Gaussian Distribution": T1
  "loop iteration": i32
  "Normal Distribution": T1
types:
  T1 = cluster{"x values": f64[], "histogram h(x)": f64[]}
uses:
  NI::Analysis::Statistics::Histogram (single-shot)(DBL Array).gvi
diagram:
  s1 = f64[] []  # shift register
  while (iteration -> i1) {
    for (N = 10) {
      for (N = 10) {
        Random Number() -> (number (0 to 1)=w3)
        append w3 to w2
      }
      append w2 to w1
    }
    Add Array Elements(numeric array=w1) -> (sum=w4)
    Divide(x=w4, y=100) -> w5
    Insert Into Array(inArray=s1, index0=i1, new=w5) -> w6
    call "Histogram (single-shot)(DBL Array).gvi"(signal=w6, number of bins=$"number of bins") -> (histogram=w7)
    $"Gaussian Distribution" <- w7
    Is Greater Or Equal(x=i1, y=1000) -> w8
    Subtract(x=w6, y=0.5) -> w9
    Square Root(x=12) -> w10
    Divide(x=w9, y=w10) -> w11
    call "Histogram (single-shot)(DBL Array).gvi"(signal=w11, number of bins=$"number of bins_2") -> (histogram=w12)
    $"Normal Distribution" <- w12
    Wait(time to wait=$"milliseconds to wait")
    $"loop iteration" <- i1
    next s1 = w6
    stop if w8
  }
