vi "DataTypes.gvi"   [LabVIEW Communications System Design Suite 2.0.1]
panel indicators:
  "unsigned byte array": u8[]
  "Converted to Farenheit": f64[]
  "HOT?": bool
  "Avg. Temp (C)": f64
diagram:
  String To Byte Array(string="kue") -> (unsigned byte array=w1)
  $"unsigned byte array" <- w1
  Subtract(x=w1, y=32) -> w2
  Divide(x=w2, y=1.8) -> w3
  $"Converted to Farenheit" <- w3
  Array Size(array=w3) -> (size(s)=w4)
  Add Array Elements(numeric array=w3) -> (sum=w5)
  Divide(x=w5, y=w4) -> w6
  $"Avg. Temp (C)" <- w6
  Is Greater Or Equal(x=w6, y=50) -> w7
  $"HOT?" <- w7
