vi "AM coherent Block.gvi"   [LabVIEW Communications System Design Suite 2.0.1]
inputs:
  "AM modulated": waveform<f64> = {dt=1, Y=[]}
  "cutoff frequency": f64 = 0.125
  "Carry signal": waveform<f64> = {dt=1, Y=[]}
  "order": i32 = 2
outputs:
  "Demodulated - DC*2": waveform<f64>
  "Demodulated - DC*2 PSD": T1
  "error out": error
panel controls:
  "error in": error
panel indicators:
  "Carrier signal": waveform<f64>
  "Demodulated output": waveform<f64>
  "AM waveform": waveform<f64>
types:
  T1 = cluster{"f0": f64, "df": f64, "magnitude": f64[]}
uses:
  NI::Analysis::Filtering::Butterworth Lowpass Filter (Waveform).gvi
  NI::Analysis::Measurement::AC DC and RMS (single-shot)(Wfm).gvi
  NI::Analysis::Measurement::Power Spectral Density for 1 Chan.gvi
diagram:
  $"AM waveform" <- $"AM modulated"
  Waveform Multiply($"Carry signal", $"AM modulated") -> w1
  call "Butterworth Lowpass Filter (Waveform).gvi"(signal=w1, cutoff frequency=$"cutoff frequency", error in=$"error in", order=$order) -> (filtered signal=w2, error out=w3)
  $"Demodulated output" <- w2
  $"Carrier signal" <- $"Carry signal"
  call "AC DC and RMS (single-shot)(Wfm).gvi"(signal=w2) -> (DC value=w4)
  Waveform Subtract(x=w2, y=w4) -> w5
  Waveform Multiply(w5, 2) -> w6
  $"Demodulated - DC*2" <- w6
  call "Power Spectral Density for 1 Chan.gvi"(signal=w6) -> (power spectral density=w7)
  $"Demodulated - DC*2 PSD" <- w7
  $"error out" <- w3
