vi "AM.gvi"   [LabVIEW Communications System Design Suite 2.0.1]
inputs:
  "msg frequency": f64 = 10
  "Am": f64 = 1
  "carrier frequency": f64 = 10
  "Ac": f64
  "sample rate msg": f64 = 1000
  "sample rate carrier": f64 = 1000
  "samples msg": i32 = 1000
  "samples carrier": i32 = 1000
outputs:
  "Message signal (TIME)": waveform<f64>
  "Carrier signal (TIME)": waveform<f64>
  "AM waveform (time)": waveform<f64>
  "Message Signal - PSD": T1
  "AM power spectrum": T1
panel controls:
  "amplitude_2": f64 = 1
panel indicators:
  "Carrier Signal - PSD_2": T1
  "Modulation index": f64
types:
  T1 = cluster{"f0": f64, "df": f64, "magnitude": f64[]}
uses:
  NI::Analysis::Generation::Sine Waveform.gvi
  NI::Analysis::Measurement::Power Spectral Density for 1 Chan.gvi
diagram:
  call "Sine Waveform.gvi"(amplitude=$Am, frequency=$"msg frequency", phase in=90, sample rate=$"sample rate msg", samples=$"samples msg") -> (sine wave=w1)
  $"Message signal (TIME)" <- w1
  Divide(x=$Am, y=$Ac) -> w2
  $"Modulation index" <- w2
  call "Power Spectral Density for 1 Chan.gvi"(signal=w1) -> (power spectral density=w3)
  $"Message Signal - PSD" <- w3
  call "Sine Waveform.gvi"(amplitude=$amplitude_2, frequency=$"carrier frequency", phase in=90, sample rate=$"sample rate carrier", samples=$"samples carrier") -> (sine wave=w4)
  Waveform Add($Ac, w1) -> w5
  Waveform Multiply(w5, w4) -> w6
  $"AM waveform (time)" <- w6
  call "Power Spectral Density for 1 Chan.gvi"(signal=w4) -> (power spectral density=w7)
  $"Carrier Signal - PSD_2" <- w7
  call "Power Spectral Density for 1 Chan.gvi"(signal=w6) -> (power spectral density=w8)
  $"AM power spectrum" <- w8
  $"Carrier signal (TIME)" <- w4
