vi "AMCoherentTesting.gvi"   [LabVIEW Communications System Design Suite 2.0.1]
panel controls:
  "msg frequency": f64 = 10
  "carrier frequency": f64 = 10
  "Am": f64 = 1
  "Ac": f64
  "sample rate msg": f64 = 1000
  "sample rate carrier": f64 = 1000
  "samples msg": i32 = 1000
  "samples carrier": i32 = 1000
  "order": i32 = 2
  "cutoff frequency": f64 = 0.125
panel indicators:
  "Carrier signal": waveform<f64>
  "Message signal": waveform<f64>
  "Demodulated output": waveform<f64>
  "AM waveform": waveform<f64>
  "Demodulated - DC*2": waveform<f64>
  "Demodulated - DC*2 PSD": T1
types:
  T1 = cluster{"f0": f64, "df": f64, "magnitude": f64[]}
uses:
  NI::Analysis::Filtering::Butterworth Lowpass Filter (Waveform).gvi
  NI::Analysis::Measurement::AC DC and RMS (single-shot)(Wfm).gvi
  NI::Analysis::Measurement::Power Spectral Density for 1 Chan.gvi
diagram:
  call "AM.gvi"(msg frequency=$"msg frequency", Am=$Am, carrier frequency=$"carrier frequency", Ac=$Ac, sample rate msg=$"sample rate msg", sample rate carrier=$"sample rate carrier", samples msg=$"samples msg", samples carrier=$"samples carrier") -> (Message signal (TIME)=w1, Carrier signal (TIME)=w2, AM waveform (time)=w3)
  $"Message signal" <- w1
  $"Carrier signal" <- w2
  Waveform Multiply(w2, w3) -> w4
  call "Butterworth Lowpass Filter (Waveform).gvi"(signal=w4, cutoff frequency=$"cutoff frequency", order=$order) -> (filtered signal=w5)
  $"Demodulated output" <- w5
  $"AM waveform" <- w3
  call "AC DC and RMS (single-shot)(Wfm).gvi"(signal=w3) -> (DC value=w6)
  Waveform Subtract(x=w5, y=w6) -> w7
  Waveform Multiply(w7, 2) -> w8
  $"Demodulated - DC*2" <- w8
  call "Power Spectral Density for 1 Chan.gvi"(signal=w8) -> (power spectral density=w9)
  $"Demodulated - DC*2 PSD" <- w9
  Property Node(instance in=w3)
