vi "USRP_AM_Tx.gvi"   [LabVIEW Communications System Design Suite 2.0.1]
panel controls:
  "Stop": bool
  "IQ rate": f64 = 500000
  "carrier frequency": f64 = 400000000
  "gain": f64
  "active antenna": string = "TX1"
  "modulation index": f64 = 1
  "message frequency": f64 = 1000
  "device names": "niUSRPClass"
  "sample rate": f64 = 500000
  "samples": i32 = 200000
panel indicators:
  "coerced IQ rate": f64
  "coerced carrier frequency": f64
  "coerced gain": f64
  "Error Out": error
  "output waveform": waveform<f64>
  "message waveform": waveform<f64>
  "PSD Message": T1
types:
  T1 = cluster{"f0": f64, "df": f64, "magnitude": f64[]}
uses:
  NI::Analysis::Generation::Sine Waveform.gvi
  NI::Analysis::Measurement::Power Spectral Density for 1 Chan.gvi
diagram:
  call "niUSRP Open Tx Session.gvi"(device names=$"device names") -> (session handle out=w1, error out=w2)
  call "niUSRP Configure Signal.gvi"(session handle=w1, IQ rate=$"IQ rate", carrier frequency=$"carrier frequency", gain=$gain, error in=w2, active antenna=$"active antenna") -> (session handle out=w3, coerced IQ rate=w4, coerced carrier frequency=w5, coerced gain=w6, error out=w7)
  $"coerced IQ rate" <- w4
  w8 = $"modulation index"
  w9 = $"message frequency"
  w10 = $"sample rate"
  w11 = $samples
  while {
    call "Sine Waveform.gvi"(amplitude=w8, frequency=w9, phase in=90, sample rate=w10, samples=w11) -> (sine wave=w12)
    Waveform Add(w12, 1) -> w13
    Property Node(instance in=w13) -> ("Y"=w14, "t0"=w15, "dt"=w16)
    Array Max And Min(array=w14) -> (max value=w17)
    Divide(x=w14, y=w17) -> w18
    Build Waveform Node(Y=w18, dt=w16, t0=w15) -> (output waveform=w19)
    $"output waveform" <- w19
    $"message waveform" <- w12
    call "Power Spectral Density for 1 Chan.gvi"(signal=w12) -> (power spectral density=w20)
    $"PSD Message" <- w20
    Real And Imaginary To Complex(x=w18, y=0) -> w21
    call "niUSRP Write Tx Data (CDB).gvi"(session handle=w3, data=w21, end of data?=$Stop, error in=w7) -> (session handle out=w22, error out=w23)
    Property Node(instance in=w23) -> ("status"=w24)
    Logical Or(w24, $Stop) -> w25
    stop if w25
  }
  call "niUSRP Close Session.gvi"(session handle=w22, error in=w23) -> (error out=w26)
  $"Error Out" <- w26
  $"coerced carrier frequency" <- w5
  $"coerced gain" <- w6
