vi "AMEnvelopeDetection.gvi"   [LabVIEW Communications System Design Suite 2.0.1]
inputs:
  "Input Differentiated FM": waveform<f64> = {dt=1, Y=[]}
  "cutoff frequency": f64 = 0.125
  "order": i32 = 2
outputs:
  "PSD": T1
  "Demodulated signal": waveform<f64>
panel indicators:
  "DC value": f64
  "Before DC": waveform<f64>
types:
  T1 = cluster{"f0": f64, "df": f64, "magnitude": f64[]}
uses:
  NI::Analysis::Filtering::Butterworth Lowpass Filter (Waveform).gvi
  NI::Analysis::Measurement::AC DC and RMS (single-shot)(Wfm).gvi
  NI::Analysis::Measurement::Power Spectral Density for 1 Chan.gvi
diagram:
  Waveform Multiply($"Input Differentiated FM", Pi) -> w1
  Property Node(instance in=w1) -> ("Y"=w2, "t0"=w3, "dt"=w4)
  for (N = 1000) {
    w5 = each element of w2
    Is Greater(x=0, y=w5) -> w7
    Select(s=w7, t=w5, f=0) -> w8
    append w8 to w6
  }
  Build Waveform Node(Y=w6, dt=w4, t0=w3) -> (output waveform=w9)
  call "Butterworth Lowpass Filter (Waveform).gvi"(signal=w9, cutoff frequency=$"cutoff frequency", order=$order) -> (filtered signal=w10)
  $"Before DC" <- w10
  call "AC DC and RMS (single-shot)(Wfm).gvi"(signal=w10) -> (DC value=w11)
  Waveform Subtract(x=w10, y=w11) -> w12
  call "Power Spectral Density for 1 Chan.gvi"(signal=w12) -> (power spectral density=w13)
  $PSD <- w13
  $"Demodulated signal" <- w12
  $"DC value" <- w11
