vi "FMDemodulator.gvi"   [LabVIEW Communications System Design Suite 2.0.1]
inputs:
  "Input FM signal": waveform<f64> = {dt=1, Y=[]}
  "cutoff frequency": f64 = 0.125
  "order": i32 = 2
outputs:
  "Demodulated FM": waveform<f64>
  "PSD": T1
types:
  T1 = cluster{"f0": f64, "df": f64, "magnitude": f64[]}
uses:
  NI::Analysis::IntegralDifferentiation::Derivative x(t).gvi
diagram:
  Property Node(instance in=$"Input FM signal") -> ("Y"=w1, "t0"=w2, "dt"=w3, "attributes"=w4)
  call "Derivative x(t).gvi"(x(t)=w1, dt=w3) -> (dx(t)/dt=w5)
  Build Waveform Node(Y=w5, attributes=w4, dt=w3, t0=w2) -> (output waveform=w6)
  call "AMEnvelopeDetection.gvi"(Input Differentiated FM=w6, cutoff frequency=$"cutoff frequency", order=$order) -> (PSD=w7, Demodulated signal=w8)
  $PSD <- w7
  $"Demodulated FM" <- w8
