vi "FM_Modulator.gvi"   [LabVIEW Communications System Design Suite 2.0.1]
inputs:
  "Carrier amplitude_2": f64 = 1
  "Carrier sample rate_2": f64 = 1000
  "MSG amplitude": f64 = 1
  "Carrier frequency_2": f64 = 10
  "Carrier Sample_2": i32 = 1000
  "Freq Deviation": f64
  "MSG frequency": f64 = 10
  "MSG phase in": f64
  "MSGsample rate": f64 = 1000
  "Msgsamples": i32 = 1000
outputs:
  "FM output": waveform<f64>
  "PSD": T1
  "Message Signal": waveform<f64>
panel indicators:
  "Sine": waveform<f64>
  "Cosine": waveform<f64>
types:
  T1 = cluster{"f0": f64, "df": f64, "magnitude": f64[]}
uses:
  NI::Analysis::Generation::Sine Waveform.gvi
  NI::Analysis::IntegralDifferentiation::Integral x(t).gvi
  NI::Analysis::Measurement::Power Spectral Density for 1 Chan.gvi
diagram:
  call "Sine Waveform.gvi"(amplitude=$"MSG amplitude", frequency=$"MSG frequency", phase in=$"MSG phase in", sample rate=$"MSGsample rate", samples=$Msgsamples) -> (sine wave=w1)
  Property Node(instance in=w1) -> ("Y"=w2, "t0"=w3, "dt"=w4, "attributes"=w5)
  call "Integral x(t).gvi"(x(t)=w2, dt=w4) -> (integral x(t)=w6)
  Multiply(PiTimes2, $"Freq Deviation") -> w7
  Multiply(w7, w6) -> w8
  Sine And Cosine(x=w8) -> (cos(x)=w9, sin(x)=w10)
  Build Waveform Node(Y=w9, attributes=w5, dt=w4, t0=w3) -> (output waveform=w11)
  $Cosine <- w11
  call "Sine Waveform.gvi"(amplitude=$"Carrier amplitude_2", frequency=$"Carrier frequency_2", phase in=90, sample rate=$"Carrier sample rate_2", samples=$"Carrier Sample_2") -> (sine wave=w12)
  Waveform Multiply(w11, w12) -> w13
  call "Sine Waveform.gvi"(amplitude=$"Carrier amplitude_2", frequency=$"Carrier frequency_2", phase in=0, sample rate=$"Carrier sample rate_2", samples=$"Carrier Sample_2") -> (sine wave=w14)
  Build Waveform Node(Y=w10, attributes=w5, dt=w4, t0=w3) -> (output waveform=w15)
  Waveform Multiply(w15, w14) -> w16
  Waveform Subtract(x=w13, y=w16) -> w17
  $"FM output" <- w17
  $Sine <- w13
  call "Power Spectral Density for 1 Chan.gvi"(signal=w17) -> (power spectral density=w18)
  $PSD <- w18
  $"Message Signal" <- w1
