vi "Top Level FM.gvi"   [LabVIEW Communications System Design Suite 2.0.1]
panel controls:
  "Carrier amplitude_2": f64 = 1
  "Carrier sample rate_2": f64 = 1000
  "Carrier frequency_2": f64 = 10
  "MSG amplitude": f64 = 1
  "MSG frequency": f64 = 10
  "MSG phase in": f64
  "MSGsample rate": f64 = 1000
  "cutoff frequency": f64 = 0.125
  "order": i32 = 2
  "Freq Deviation": f64
  "Carrier Sample_2": i32 = 1000
  "Msgsamples": i32 = 1000
  "stop": bool
panel indicators:
  "Demodulated FM": waveform<f64>
  "PSD Demodulated FM": T1
  "Message signal": waveform<f64>
  "PSD FM signal": T1
  "Message signal PSD": T1
  "FM signal": waveform<f64>
  "DC/Freq div": waveform<f64>
  "Demodulated signal FINAL": waveform<f64>
types:
  T1 = cluster{"f0": f64, "df": f64, "magnitude": f64[]}
uses:
  NI::Analysis::Measurement::Power Spectral Density for 1 Chan.gvi
diagram:
  while {
    call "FM_Modulator.gvi"(Carrier amplitude_2=$"Carrier amplitude_2", Carrier sample rate_2=$"Carrier sample rate_2", MSG amplitude=$"MSG amplitude", Carrier frequency_2=$"Carrier frequency_2", Carrier Sample_2=$"Carrier Sample_2", Freq Deviation=$"Freq Deviation", MSG frequency=$"MSG frequency", MSG phase in=$"MSG phase in", MSGsample rate=$"MSGsample rate", Msgsamples=$Msgsamples) -> (FM output=w1, PSD=w2, Message Signal=w3)
    $"FM signal" <- w1
    call "FMDemodulator.gvi"(Input FM signal=w1, cutoff frequency=$"cutoff frequency", order=$order) -> (Demodulated FM=w4, PSD=w5)
    Multiply($"Freq Deviation", $"Carrier amplitude_2") -> w6
    Waveform Divide(x=w4, y=w6) -> w7
    Waveform Divide(x=w7, y=PiTimes2) -> w8
    $"Demodulated signal FINAL" <- w8
    $"DC/Freq div" <- w7
    $"Demodulated FM" <- w4
    $"PSD Demodulated FM" <- w5
    $"PSD FM signal" <- w2
    $"Message signal" <- w3
    call "Power Spectral Density for 1 Chan.gvi"(signal=w3) -> (power spectral density=w9)
    $"Message signal PSD" <- w9
    stop if $stop
  }
