vi "BPSK_Tx_Rx_Template.gvi"   [LabVIEW Communications System Design Suite 2.0.1]
panel controls:
  "IQ rate": f64 = 200000
  "device names": "niUSRPClass"
  "carrier frequency": f64 = 400000000
  "gain Tx": f64
  "active antenna Tx": string = "TX1"
  "stop Tx": bool
  "gain Rx": f64
  "active antenna Rx": string = "RX2"
  "total bits": i32 = 128
panel indicators:
  "Baseband Waveform": waveform<f64>
  "Baseband Power Spectrum": T1
  "Baseband Output": cluster{"t0": f64, "dt": f64, "Y": f64[]}
types:
  T1 = cluster{"f0": f64, "df": f64, "magnitude": f64[]}
diagram:
  Build Waveform Node() -> (output waveform=w1)
  $"Baseband Waveform" <- w1
  w2 = cluster{"t0": f64, "dt": f64, "Y": f64[]} {all zero or empty}
  Property Node(instance in=w2) -> (instance out=w3)  # Cluster Properties
  $"Baseband Output" <- w3
  w4 = cluster{"t0": timestamp, "dt": f64, "Y": c128[]} {all zero or empty}
  Property Node(instance in=w4) -> (instance out=w5)
  call "FFT Power Spectrum for 1 Chan (CDB)2.gvi"(time signal=w5, dB On (F)=TRUE) -> (power spectrum=w6)
  $"Baseband Power Spectrum" <- w6
  call "niUSRP Open Rx Session.gvi"(device names=$"device names") -> (error out=w7, session handle out=w8)
  call "niUSRP Configure Signal.gvi"(session handle=w8, IQ rate=$"IQ rate", carrier frequency=$"carrier frequency", gain=$"gain Rx", error in=w7, active antenna=$"active antenna Rx") -> (session handle out=w9, coerced carrier frequency=w10, error out=w11)
  Subtract(x=w10, y=20000) -> w12
  Property Node(instance in=w9, "LO Frequency"=w12) -> (instance out=w13)
  call "niUSRP Initiate.gvi"(session handle=w13, error in=w11) -> (session handle out=w14, error out=w15)
  call "niUSRP Fetch Rx Data (CDB).gvi"(session handle=w14, number of samples=1000000, error in=w15) -> (session handle out=w16, error out=w17)
  call "niUSRP Close Session.gvi"(session handle=w16, error in=w17)
  call "niUSRP Open Tx Session.gvi"(device names=$"device names") -> (session handle out=w18, error out=w19)
  call "niUSRP Configure Signal.gvi"(session handle=w18, IQ rate=$"IQ rate", carrier frequency=$"carrier frequency", gain=$"gain Tx", error in=w19, active antenna=$"active antenna Tx") -> (session handle out=w20, error out=w21)
  while {
    call "niUSRP Write Tx Data (CDB).gvi"(session handle=w20, error in=w21) -> (session handle out=w22, error out=w23)
    stop if $"stop Tx"
  }
  call "niUSRP Close Session.gvi"(session handle=w22, error in=w23)
  Random Number() -> (number (0 to 1)=w24)
  call "MT Generate Bits (Fibonacci, PN Order).gvi"(total bits=$"total bits", seed in=w24) -> (output bit stream=w25)
  Insert Into Array(new=w25)
