vi "Test.gvi"   [LabVIEW Communications System Design Suite 2.0.1]
panel controls:
  "total bits": i32 = 128
panel indicators:
  "input": i8[]
  "output array": f64[]
  "loop iteration": i32
  "appended array": f64[]
diagram:
  call "MT Generate Bits (Fibonacci, PN Order).gvi"(total bits=$"total bits") -> (output bit stream=w1)
  $input <- w1
  Is Equal To 0(x=w1) -> w2
  s1 = f64[] []  # shift register
  for (iteration -> i1) (after w1) {
    w3 = each element of w2
    Wait(time to wait=1000)
    $"loop iteration" <- i1
    Select(s=w3, t=-1, f=1) -> w4
    Insert Into Array(inArray=s1, index0=i1, new=w4) -> w5
    $"output array" <- w5
    next s1 = w5
  }
  Build Array(w4) -> w6
  $"appended array" <- w6
