vi "USRP_AM_Rx_Music.gvi"   [LabVIEW Communications System Design Suite 2.0.1]
panel controls:
  "number of samples": i64 = 1000000
  "IQ rate": f64 = 100000
  "carrier frequency": f64 = 400000000
  "gain": f64
  "active antenna": string = "RX2"
  "Stop": bool
  "device names": "niUSRPClass"
panel indicators:
  "coerced IQ rate": f64
  "coerced carrier frequency": f64
  "coerced gain": f64
  "Demodulated signal": waveform<f64>
  "Demodulated PSD": T1
  "error out": error
types:
  T1 = cluster{"f0": f64, "df": f64, "magnitude": f64[]}
uses:
  NI::Analysis::Measurement::AC DC and RMS (single-shot)(1D DBL).gvi
  NI::Analysis::Measurement::Power Spectrum for 1 Chan.gvi
diagram:
  call "niUSRP Open Rx Session.gvi"(device names=$"device names") -> (error out=w1, session handle out=w2)
  call "niUSRP Configure Signal.gvi"(session handle=w2, IQ rate=$"IQ rate", carrier frequency=$"carrier frequency", gain=$gain, error in=w1, active antenna=$"active antenna") -> (session handle out=w3, coerced IQ rate=w4, coerced carrier frequency=w5, coerced gain=w6, error out=w7)
  $"coerced IQ rate" <- w4
  $"coerced carrier frequency" <- w5
  call "niUSRP Initiate.gvi"(session handle=w3, error in=w7) -> (session handle out=w8, error out=w9)
  call "Simple Sound.gvi"(Action="Open") -> (sample rate (S/s)=w10, Error=w11, task ID=w12)
  w13 = $"number of samples"
  while {
    call "niUSRP Fetch Rx Data (CDB WDT).gvi"(session handle=w8, number of samples=w13, error in=w9) -> (session handle out=w14, data=w15, error out=w16)
    Property Node(instance in=w15) -> ("Y"=w17, "t0"=w18)
    Complex To Polar(r * e^(i*theta)=w17) -> (r=w19)
    call "AC DC and RMS (single-shot)(1D DBL).gvi"(signal=w19) -> (DC value=w20)
    Subtract(x=w19, y=w20) -> w21
    call "Simple Resample.gvi"(input=w21, coerced IQ rate=44100, sample rate (S/s)=w10) -> (output=w22)
    Reciprocal(x=44100) -> w23
    Build Waveform Node(Y=w22, dt=w23) -> (output waveform=w24)
    call "Simple Sound.gvi"(device ID=w12, error in (no error)=w11, Action="Write", data=w24) -> (Error=w25, task ID=w26)
    Build Waveform Node(Y=w21, dt=w23, t0=w18) -> (output waveform=w27)
    $"Demodulated signal" <- w27
    call "Power Spectrum for 1 Chan.gvi"(signal=w27) -> (power spectrum=w28)
    $"Demodulated PSD" <- w28
    Property Node(instance in=w16) -> ("status"=w29)
    Logical Or(w29, $Stop) -> w30
    stop if w30
  }
  call "Simple Sound.gvi"(device ID=w26, error in (no error)=w25, Action="Close") -> (Error=w31)
  Merge Errors(w31, w16) -> (error out=w32)
  call "niUSRP Abort.gvi"(session handle=w14, error in=w32) -> (session handle out=w33, error out=w34)
  call "niUSRP Close Session.gvi"(session handle=w33, error in=w34) -> (error out=w35)
  $"error out" <- w35
  $"coerced gain" <- w6
